# Grasshopper definition example8.gh (Grasshopper 1.0.7)
# Copyright: © 2017-2018 Pierre Cuvilliers, Caitlin Mueller, Massachusetts Institute of Technology

panel = Panel("""numpy
scipy
matplotlib
matplotlib.pyplot
aeropy
aeropy.airfoils
aeropy.airfoils.shapes
aeropy.airfoils.analysis
git""")
# GH to python remote, matplotlib example.
# Pierre Cuvilliers, 2017-2018
# Released under the MIT license
# github.com/pilcru/ghpythonremote
# Runs and connects to an external python engine, and
# assigns imported modules to scriptcontext.sticky variables.
# 
# Arguments:
#       code (str): Path to the GH_to_python_sticky.py code file.
#       location (str): Path to a python executable, or to a folder
#             containing `python.exe`, or the name of a conda-created
#             virtual environment prefixed by `conda://` (`conda://env_name`).
#             If empty, finds python from your windows %PATH%.
#       run (boolean): Creates the connection, and imports new
#             modules, when turned to True. Kills the connection,
#             and deletes the references to the imports, when turned
#             to False.
#       modules (str list): List of module names to import in the
#             remote python. They will be added to the
#             scriptcontext.sticky dictionary, allowing them to be
#             reused from other python components in the same
#             Grasshopper document. Submodules (for example
#             `numpy.linalg`) have to be added explicitly to this list
#             to be available later, and importing the parent package is
#             also required even if only the submodule is used.
#       log_level (str from ['NOTSET', 'DEBUG', 'INFO', 'WARNING', 'ERROR', 'CRITICAL']):
#             Logging level to use for the local IronPython and the
#             remote python instance.
#       working_dir (str): Working directory for the remote python
#             instance.
# 
# Returns:
#       out (str): Console output with DEBUG information.
#       linked_modules (str list): list of imported module names.
#       rpy (rpyc connection object): The object representing the
#             remote Python interpreter.
panel_2 = Panel("conda://rhinoremote")
scale = Slider(1, range=0..10)
init = BooleanToggle(False)
naca_num = Panel("4414")
pythonremote = GHPythonRemote(location=panel_2, run=Toggle(True), modules=panel)  # -> out, linked_modules, rpy, import_statements
dynamic_viscoisty = Panel("0.0000181")
git = GhPythonScript(x=init)  # -> out, b, a
# ---------- git: Python ----------
import Grasshopper as gh
import scriptcontext
git = scriptcontext.sticky['git']

io = gh.Kernel.GH_DocumentIO(ghenv.Component.OnPingDocument())
io.SaveAs()
import os.path
abspath = ghenv.LocalScope.ghdoc.Path
a =os.path.dirname(abspath)
b =os.path.basename(abspath)
a = a.replace("\\","\\\\")

repo =git.Repo.init(a)
repo.git.add(b)
repo.git.commit('-m', 'commit message from grasshopper')
origin = repo.remote(name='origin')
origin.push()
# ---------- end git ----------
U = Panel("20")
density = Panel("1.225")
init_2 = BooleanToggle(True)
txt = Text(naca_num)
panel_3 = Panel(git.b)
panel_4 = Panel(git.a)
num = Number(U)
num_2 = Number(density)
num_3 = Number(dynamic_viscoisty)
panel_5 = Panel(pythonremote.out)
naca_4_digit = PythonScript(y=txt, x=init_2)  # -> out, d, c, a, b
# ---------- naca_4_digit: Python ----------
import scriptcontext
np = scriptcontext.sticky['numpy']
mpl = scriptcontext.sticky['matplotlib']
plt = mpl.pyplot
aeropy = scriptcontext.sticky['aeropy']

if x == True:
    # CST shape
    d, c = aeropy.airfoils.shapes.naca(y, 99, half_cosine_spacing=False)
    a = []
    for index in c:
        a.append(str(index))
    b = []
    for index in d:
        b.append(str(index))
# ---------- end naca_4_digit ----------
re_number = Evaluate(F="(x*y*z)/u", x=num_2, y=num, z=scale, u=num_3)
num_4 = Number(naca_4_digit.a)
re_number_2 = Panel(re_number)
init_3 = BooleanToggle(True)
num_5 = Number(naca_4_digit.b)
scale_x = Multiplication(A=num_4, B=scale)
scale_y = Multiplication(A=num_5, B=scale)
num_6 = Number(re_number_2)
num_7 = Number("0")
xfoil = GhPythonScript(re=num_6, x=naca_4_digit.d, y=naca_4_digit.c, z=init_3)  # -> out, a
# ---------- xfoil: Python ----------
import scriptcontext
np = scriptcontext.sticky['numpy']
mpl = scriptcontext.sticky['matplotlib']
plt = mpl.pyplot
aeropy = scriptcontext.sticky['aeropy']

x = np.array(x)
y = np.array(y)

if z == True:
    alphas = np.arange(0, 20, 1) * np.pi / 180.
    xfoil_alphas, xfoil_c_p, xfoil_control_x, xfoil_control_y, xfoil_c_l, xfoil_c_d = aeropy.airfoils.analysis.xfoil(alphas, x, y,GDES=True, Re = re)
    a = str(np.amax(xfoil_c_l))
# ---------- end xfoil ----------
thickness = Slider(-0.005, range=-0.3..0)
point_path = ConstructPoint(XCoordinate=scale_x, YCoordinate=scale_y, ZCoordinate=num_7)
aoa = Slider(0, range=0..3)
cl_max = Panel(xfoil.a)
plot_curve = Interpolate(Vertices=point_path, Degree=3, Periodic=False, KnotStyle=1)  # -> Curve, Length, Domain
offset = OffsetCurve(Curve=plot_curve.Curve, Distance=thickness, Plane=PlaneXY(0, 0, 0), Corners=1)
xy = XYPlane(Origin=Point(0, 0, 0))
rotate = Rotate(Geometry=plot_curve.Curve, Angle=aoa, Plane=PlaneXY(0, 0, 0))  # -> Geometry, Transform
num_8 = Number(density)
num_9 = Number(U)
rotate_2 = Rotate(Geometry=offset, Angle=aoa, Plane=PlaneXY(0, 0, 0))  # -> Geometry, Transform
extr = Extrude(Base=rotate.Geometry, Direction=xy)
force = Evaluate(F="((x*1.225*y²*z*u)/2)", x=num_8, y=num_9, z=cl_max, u=scale)
force_2 = Panel(force)
extr_2 = Extrude(Base=rotate_2.Geometry, Direction=xy)

# ==== cluster GHPythonRemote: Connects the Grasshopper Python component to an external Python instance.
python = PythonScript()  # -> gh_parent_doc_dir
# ---------- python: Python ----------
from os import path

gh_parent_doc_dir = path.abspath(path.dirname(ghenv.Component.OnPingDocument().Owner.OnPingDocument().FilePath))
# ---------- end python ----------
# GH to python remote example.
# Pierre Cuvilliers, 2017-2018
# Released under the MIT license
# github.com/pilcru/ghpythonremote
# Runs and connects to an external python engine, and
# assigns imported modules to scriptcontext.sticky variables.
# 
# Arguments:
#       code (str): Path to the GH_to_python_sticky.py code file.
#       location (str): Path to a python executable, or to a folder
#             containing `python.exe`, or the name of a conda-created
#             virtual environment prefixed by `conda://` (`conda://env_name`).
#             If empty, finds python from your windows %PATH%.
#       run (boolean): Creates the connection, and imports new
#             modules, when turned to True. Kills the connection,
#             and deletes the references to the imports, when turned
#             to False.
#       modules (str list): List of module names to import in the
#             remote python. They will be added to the
#             scriptcontext.sticky dictionary, allowing them to be
#             reused from other python components in the same
#             Grasshopper document. Submodules (for example
#             `numpy.linalg` have to be added explicitly to this list
#             to be available later.
#       log_level (str from ['NOTSET', 'DEBUG', 'INFO', 'WARNING', 'ERROR', 'CRITICAL']):
#             Logging level to use for the local IronPython and the
#             remote python instance.
#       working_dir (str): Working directory for the remote python
#             instance.
# 
# Returns:
#       out (str): Console output with DEBUG information.
#       linked_modules (str list): list of imported module names.
#       rpy (rpyc connection object): The object representing the
#             remote Python interpreter.
location = ClusterInput()  # location (str): Path to a python executable, or to a folder containing `python.exe`, or the name of a conda-created virtual environment prefixed by `conda://` (`conda://env_name`). If empty, finds python from your windows %PATH%.
run = ClusterInput()  # run (boolean): Creates the connection, and imports new modules, when turned to True. Kills the connection,and deletes the references to the imports, when turned to False.
modules = ClusterInput()  # modules (str list): List of module names to import in the remote python. They will be added to the scriptcontext.sticky dictionary, allowing them to be reused from other python components in the same Grasshopper document. Submodules (for example `numpy.linalg` have to be added explicitly to this list to be available later.
list = ValueList({"CRITICAL", "ERROR", "WARNING", "INFO", "DEBUG", "NOTSET"}, selected="DEBUG")
panel = Panel(python)
ghpythonremote = GHPythonRemote(location=location, run=run, modules=modules, log_level=list, working_dir=panel)  # -> out, linked_modules, rpy; inputs run: Boolean, modules: list
# ---------- ghpythonremote: Python ----------
import inspect
import logging
from os import path
import sys
from time import sleep

import scriptcontext

import ghpythonremote
from ghpythonremote.connectors import GrasshopperToPythonRemote

local_log_level = getattr(logging, log_level, logging.WARNING)
logger = logging.getLogger("ghpythonremote")
logger.setLevel(local_log_level)
ch = logging.StreamHandler()
ch.setLevel(local_log_level)
formatter = logging.Formatter("%(levelname)s: %(name)s:\n%(message)s")
ch.setFormatter(formatter)
logger.handlers = []
logger.addHandler(ch)
logger = logging.getLogger("ghpythonremote.GH_to_python")

ROOT = path.abspath(path.dirname(inspect.getfile(ghpythonremote)))
rpyc_server_py = path.join(ROOT, "pythonservice.py")

# Set connection to CLOSED if this is the first run
# and initialize set of linked modules
try:
    remote_python_status
except NameError:
    remote_python_status = "CLOSED"
    lkd_modules = set()

# Wait for connection to connect or terminate
timer = 0
while remote_python_status == "CONNECTING" or remote_python_status == "CLOSING":
    sleep(1)
    timer += 1
    if timer == 10:
        try:
            gh2py_manager.__exit__(*sys.exc_info())
        except Exception:
            pass
        remote_python_status = "CLOSED"
        lkd_modules = set()
        raise RuntimeError(
            "Connection left in an inconsistent state and not returning. Reset "
            "everything."
        )

if run:
    if not remote_python_status == "OPEN":
        remote_python_status = "CONNECTING"
        gh2py_manager = GrasshopperToPythonRemote(
            rpyc_server_py,
            location=location,
            timeout=10,
            port=None,
            log_level=log_level,
            working_dir=working_dir,
        )
        gh2py = gh2py_manager.__enter__()
        remote_python_status = "OPEN"

    # Stuff that we can reach
    rpymod = gh2py.py_remote_modules  # A getter function for a named python module
    rpy = gh2py.connection  # Represents the remote instance root object
    scriptcontext.sticky["rpy"] = rpy
    # Add modules
    for mod in modules:
        try:
            scriptcontext.sticky[mod] = rpymod(mod)
            lkd_modules.add(mod)
        except ImportError:
            gh2py_manager.__exit__(*sys.exc_info())
            raise

elif not remote_python_status == "CLOSED":
    remote_python_status = "CLOSING"
    # Remove linked modules
    for mod in lkd_modules:
        del scriptcontext.sticky[mod]
    del scriptcontext.sticky["rpy"]
    gh2py_manager.__exit__(*sys.exc_info())
    lkd_modules = set()
    remote_python_status = "CLOSED"

# Change variable name because ghpython resets outputs to None before each run
linked_modules = lkd_modules

logger.info("GH to python connection is {}".format(remote_python_status))
# ---------- end ghpythonremote ----------
out = ClusterOutput(ghpythonremote.out)  # Console output.
linked_modules = ClusterOutput(ghpythonremote.linked_modules)  # Names of modules that were successfully added to the scriptcontext.sticky dictionary.
rpy = ClusterOutput(ghpythonremote.rpy)  # The object representing the remote python instance
python_2 = PythonScript(module_names=ghpythonremote.linked_modules)  # -> import_statements; inputs module_names: list
# ---------- python_2: Python ----------
import_statements = ["import scriptcontext as sc"]
for module_name in module_names:
    import_statements.append("{0} = sc.sticky['{0}']".format(module_name))

if len(module_names) == 0:
    import_statements = []
# ---------- end python_2 ----------
import_statements = ClusterOutput(python_2)  # Useful import statements to use the imported modules in your scripts.
