# Grasshopper definition template-python-remote.gh (Grasshopper 1.0.7)
# Copyright: © 2017-2018 Pierre Cuvilliers, Caitlin Mueller, Massachusetts Institute of Technology

# ----
# Library Imports
# Double-click me and copy and paste
# my code to your own workflow. There
# are comments inside to further guide you.
python = GhPythonScript()  # -> out, a
# ---------- python: Python ----------
__author__ = "eu_chian"
__version__ = "2020.05.06"

import rhinoscriptsyntax as rs

# this is the library that brings in the integration
import scriptcontext

# this is how you set the libraries
np = scriptcontext.sticky['numpy']
mpl = scriptcontext.sticky['matplotlib']
aeropy = scriptcontext.sticky['aeropy']

# remember to get sub-libraries, they need to be 
# explicit stated in the list of modules for the
# python remote block for the code below to work
plt = mpl.pyplot
# ---------- end python ----------

# ----
# Python Remote Integration
# This is the set of default python libraries
# that will be activated. Double-click on the
# panel to add more libraries that you have
# already added into your rhinoremote
# environment.
python_libraries = Panel("""numpy
scipy
scipy.interpolate
matplotlib
matplotlib.pyplot
aeropy
aeropy.airfoils
aeropy.airfoils.shapes
aeropy.airfoils.analysis
git""")
# READ ME FIRST
# Copy and paste this entire workflow into your own. You can also access the Python Remote
# block in the Maths > Script tab above although you wouldn't have the panels and toggles.
# Best bet is still to copy the workflow below.
panel = Panel("conda://rhinoremote")
# Double-click on False to change
# it to True and start the python
# remote integration. The other
# blocks will then change from
# red to grey.
pythonremote = GHPythonRemote(location=panel, run=Toggle(True), modules=python_libraries)  # -> out, linked_modules, rpy, import_statements
debug_panel = Panel(pythonremote.out)

# ----
# Using Numpy
# To use numpy and get back your values into Grasshopper, you'll
# need to convert them as you're technically running calculations on
# another environment. Double-click the python block below to see
# how. There comments inside to further guide this.
python_2 = GhPythonScript()  # -> arr, elem, elem2, arr2
# ---------- python_2: Python ----------
__author__ = "eu_chian"
__version__ = "2020.05.06"

import rhinoscriptsyntax as rs

import scriptcontext
np = scriptcontext.sticky['numpy']

# Let's say you're creating a numpy array.
# If you immediately output them, grasshopper
# doesn't see list or even the element as numbers.
# (see the panels)
arr = np.linspace(0, 20, 20)
elem = arr[3]

# So you'll need to convert it within this environment back
# to standard python primitives that grasshopper can understand.

# One work around is to convert it to a string then convert it
# back to float or int (given you're context)
elem2 = float(str(elem))

# Thus for an entire numpy array, you'll need to convert the
# individual elements using list comprehension
arr2 = [float(str(i)) for i in arr]

# A more robust and faster (especially with large multi-d arrays)
# is to use the obtain function from ghpythonremote
import ghpythonremote
elem2 = ghpythonremote.obtain(elem.tolist())

# thus for an entire array you don't have to convert each element
arr2 = ghpythonremote.obtain(arr.tolist())
# ---------- end python_2 ----------
panel_2 = Panel(python_2.arr)
panel_3 = Panel(python_2.elem)
panel_4 = Panel(python_2.elem2)
panel_5 = Panel(python_2.arr2)

# ----
# Use this panel to ensure there
# are no `ERROR:` messages which
# means that the integration is
# successful.
gallery = ImageGallery(CycleDelay=30, Randomize=False, UseLocalImages=True, UseRemoteImages=True)

# ==== cluster GHPythonRemote: Connects the Grasshopper Python component to an external Python instance.
python = PythonScript()  # -> gh_parent_doc_dir
# ---------- python: Python ----------
from os import path

gh_parent_doc_dir = path.abspath(path.dirname(ghenv.Component.OnPingDocument().Owner.OnPingDocument().FilePath))
# ---------- end python ----------
# GH to python remote example.
# Pierre Cuvilliers, 2017-2018
# Released under the MIT license
# github.com/pilcru/ghpythonremote
# Runs and connects to an external python engine, and
# assigns imported modules to scriptcontext.sticky variables.
# 
# Arguments:
#       code (str): Path to the GH_to_python_sticky.py code file.
#       location (str): Path to a python executable, or to a folder
#             containing `python.exe`, or the name of a conda-created
#             virtual environment prefixed by `conda://` (`conda://env_name`).
#             If empty, finds python from your windows %PATH%.
#       run (boolean): Creates the connection, and imports new
#             modules, when turned to True. Kills the connection,
#             and deletes the references to the imports, when turned
#             to False.
#       modules (str list): List of module names to import in the
#             remote python. They will be added to the
#             scriptcontext.sticky dictionary, allowing them to be
#             reused from other python components in the same
#             Grasshopper document. Submodules (for example
#             `numpy.linalg` have to be added explicitly to this list
#             to be available later.
#       log_level (str from ['NOTSET', 'DEBUG', 'INFO', 'WARNING', 'ERROR', 'CRITICAL']):
#             Logging level to use for the local IronPython and the
#             remote python instance.
#       working_dir (str): Working directory for the remote python
#             instance.
# 
# Returns:
#       out (str): Console output with DEBUG information.
#       linked_modules (str list): list of imported module names.
#       rpy (rpyc connection object): The object representing the
#             remote Python interpreter.
location = ClusterInput()  # location (str): Path to a python executable, or to a folder containing `python.exe`, or the name of a conda-created virtual environment prefixed by `conda://` (`conda://env_name`). If empty, finds python from your windows %PATH%.
run = ClusterInput()  # run (boolean): Creates the connection, and imports new modules, when turned to True. Kills the connection,and deletes the references to the imports, when turned to False.
modules = ClusterInput()  # modules (str list): List of module names to import in the remote python. They will be added to the scriptcontext.sticky dictionary, allowing them to be reused from other python components in the same Grasshopper document. Submodules (for example `numpy.linalg` have to be added explicitly to this list to be available later.
list = ValueList({"CRITICAL", "ERROR", "WARNING", "INFO", "DEBUG", "NOTSET"}, selected="DEBUG")
panel = Panel(python)
ghpythonremote = GHPythonRemote(location=location, run=run, modules=modules, log_level=list, working_dir=panel)  # -> out, linked_modules, rpy; inputs run: Boolean, modules: list
# ---------- ghpythonremote: Python ----------
import inspect
import logging
from os import path
import sys
from time import sleep

import scriptcontext

import ghpythonremote
from ghpythonremote.connectors import GrasshopperToPythonRemote

local_log_level = getattr(logging, log_level, logging.WARNING)
logger = logging.getLogger("ghpythonremote")
logger.setLevel(local_log_level)
ch = logging.StreamHandler()
ch.setLevel(local_log_level)
formatter = logging.Formatter("%(levelname)s: %(name)s:\n%(message)s")
ch.setFormatter(formatter)
logger.handlers = []
logger.addHandler(ch)
logger = logging.getLogger("ghpythonremote.GH_to_python")

ROOT = path.abspath(path.dirname(inspect.getfile(ghpythonremote)))
rpyc_server_py = path.join(ROOT, "pythonservice.py")

# Set connection to CLOSED if this is the first run
# and initialize set of linked modules
try:
    remote_python_status
except NameError:
    remote_python_status = "CLOSED"
    lkd_modules = set()

# Wait for connection to connect or terminate
timer = 0
while remote_python_status == "CONNECTING" or remote_python_status == "CLOSING":
    sleep(1)
    timer += 1
    if timer == 10:
        try:
            gh2py_manager.__exit__(*sys.exc_info())
        except Exception:
            pass
        remote_python_status = "CLOSED"
        lkd_modules = set()
        raise RuntimeError(
            "Connection left in an inconsistent state and not returning. Reset "
            "everything."
        )

if run:
    if not remote_python_status == "OPEN":
        remote_python_status = "CONNECTING"
        gh2py_manager = GrasshopperToPythonRemote(
            rpyc_server_py,
            location=location,
            timeout=10,
            port=None,
            log_level=log_level,
            working_dir=working_dir,
        )
        gh2py = gh2py_manager.__enter__()
        remote_python_status = "OPEN"

    # Stuff that we can reach
    rpymod = gh2py.py_remote_modules  # A getter function for a named python module
    rpy = gh2py.connection  # Represents the remote instance root object
    scriptcontext.sticky["rpy"] = rpy
    # Add modules
    for mod in modules:
        try:
            scriptcontext.sticky[mod] = rpymod(mod)
            lkd_modules.add(mod)
        except ImportError:
            gh2py_manager.__exit__(*sys.exc_info())
            raise

elif not remote_python_status == "CLOSED":
    remote_python_status = "CLOSING"
    # Remove linked modules
    for mod in lkd_modules:
        del scriptcontext.sticky[mod]
    del scriptcontext.sticky["rpy"]
    gh2py_manager.__exit__(*sys.exc_info())
    lkd_modules = set()
    remote_python_status = "CLOSED"

# Change variable name because ghpython resets outputs to None before each run
linked_modules = lkd_modules

logger.info("GH to python connection is {}".format(remote_python_status))
# ---------- end ghpythonremote ----------
out = ClusterOutput(ghpythonremote.out)  # Console output.
linked_modules = ClusterOutput(ghpythonremote.linked_modules)  # Names of modules that were successfully added to the scriptcontext.sticky dictionary.
rpy = ClusterOutput(ghpythonremote.rpy)  # The object representing the remote python instance
python_2 = PythonScript(module_names=ghpythonremote.linked_modules)  # -> import_statements; inputs module_names: list
# ---------- python_2: Python ----------
import_statements = ["import scriptcontext as sc"]
for module_name in module_names:
    import_statements.append("{0} = sc.sticky['{0}']".format(module_name))

if len(module_names) == 0:
    import_statements = []
# ---------- end python_2 ----------
import_statements = ClusterOutput(python_2)  # Useful import statements to use the imported modules in your scripts.
